# Grasshopper definition Repulsion_Example_001.gh (Grasshopper 0.9.76)
# plug-ins: RCDUtilities

number_slider = Slider(75, range=0..100)
planesrf = PlaneSurface(Plane=PlaneXY(0, 0, 0), XSize=Domain(-10, 10), YSize=Domain(-10, 10))
scale = Scale(Geometry=planesrf, Center=Point(0, 0, 0), Factor=0.5)  # -> Geometry, Transform
crv = Curve(planesrf)
popgeo = PopulateGeometry(Geometry=scale.Geometry, Count=number_slider, Seed=1)
random = Random(Range=Domain(0.3, 2), Number=number_slider, Seed=2)

# ---- group: Reset here
toggle = BooleanToggle(False)

# ---- group: Don't forget to enable
timer = Timer(TimerInterval=20, Target=node_repulsion)  # disabled

# ----
node_repulsion = RepulsionTimer(Manifold=planesrf, Points=popgeo, Cutoff=random, InitialForce=Slider(0.2, range=0..1), Damping=0.99, Reset=toggle)
cir = Circle(Plane=node_repulsion, Radius=random)
